# Grasshopper definition CBDM-Assignment-1_Fadi.gh (Grasshopper 1.0.7)
# plug-ins: Kangaroo2 Components, LunchBox
# Spherical spikey thing

attractor_u_position_0_00_to_1_00 = GetNumber(Slider(0.26, range=0..1), AtLeast=1, AtMost=1, Maximum=1.797693135e+308, Minimum=-1.797693135e+308, TreeAccess=False)
attractor_v_position_0_00_to_1_00 = GetNumber(Slider(0.47, range=0..1), AtLeast=1, AtMost=1, Maximum=1.797693135e+308, Minimum=-1.797693135e+308, TreeAccess=False)
range_0_00_to_70_00 = GetNumber(Slider(15.19, range=0..40), AtLeast=1, AtMost=1, Maximum=1.797693135e+308, Minimum=-1.797693135e+308, TreeAccess=False)
force_0_00_to_70_00 = GetNumber(Slider(70, range=0..70), AtLeast=1, AtMost=1, Maximum=1.797693135e+308, Minimum=-1.797693135e+308, TreeAccess=False)
boundary = BoundarySurfaces(Edges=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)
concat = Concatenate(FragmentA=attractor_u_position_0_00_to_1_00, FragmentC=",", FragmentB=attractor_v_position_0_00_to_1_00)
evalsrf = EvaluateSurface(Surface=reparameterize(boundary), Point=concat)  # -> Point, Normal, UDirection, VDirection, Frame
mesh_uv = MeshSurface(Surface=boundary, UCount=5, VCount=5, Overhang=True, Equalize=False)
triremesh = TriRemesh(Geometry=mesh_uv, Length=Slider(6, range=0..10), Iterations=25)  # -> Triangulation, Dual, Creases
faceb = FaceBoundaries(Mesh=triremesh.Triangulation)
explode = Explode(Curve=faceb, Recursive=True)  # -> Segments, Vertices
curvepoint = PointOnCurve(explode.Segments, parameter=0.5)
avr = Average(Input=curvepoint)  # -> flatten(ArithmeticMean)
rtree = CreateRTree(InputGeometry=avr)
yz = YZPlane(Origin=Point(0, 0, 0))
rtree_range = RTreePointsInRange(SearchPoints=evalsrf.Point, SearchDistance=range_0_00_to_70_00, RTree=rtree)  # -> PointsWithinRange, IndicesWithinRange
project = Project(Geometry=evalsrf.Point, Plane=yz)  # -> Geometry, Transform

dist = Distance(PointA=evalsrf.Point, PointB=rtree_range.PointsWithinRange)
bnd = Bounds(Numbers=dist)
dom = ConstructDomain(DomainStart=force_0_00_to_70_00, DomainEnd=Slider(0, range=0..10))
remap = RemapNumbers(Value=dist, Source=bnd, Target=Domain(0, 1))  # -> Mapped, Clipped
graph = GraphMapper(
    remap.Mapped,
    x0=0,
    x1=1,
    y0=0,
    y1=1,
    container_name="Bezier",
    cpx=[0, 0.1964500546, 0.4582784772, 1],
    cpy=[0, 0.3217331171, 0.9606380463, 1])
bnd_2 = Bounds(Numbers=graph)
remap_2 = RemapNumbers(Value=graph, Source=bnd_2, Target=dom)  # -> Mapped, Clipped

X = UnitX(Factor=remap_2.Mapped)
move = Move(Geometry=rtree_range.PointsWithinRange, Motion=X)  # -> Geometry, Transform
replace = ReplaceItems(List=avr, Item=move.Geometry, Indices=rtree_range.IndicesWithinRange, Wrap=False)
dup = DuplicateData(Data=graft(replace), Number="3", Order=True)
pshift = ShiftPaths(Data=dup, Offset=-1)  # -> graft(Data)
path_mapper = PathMapper(pshift, source="{A;B;C;D;E}", target="{B;C;D;E}")
end = EndPoints(Curve=graft(explode.Segments))  # -> Start, End
merge = Merge(Data1=end.Start, Data2=end.End, Data3=path_mapper)
triangle = MeshTriangle(CornerA=0, CornerB=1, CornerC=2)
conmesh = ConstructMesh(Vertices=merge, Faces=triangle)
platoocta = PlatonicOctahedron(Plane=project.Geometry, Radius=Slider(2.5, range=0..10), Truncation=0)
mjoin = MeshJoin(Meshes=flatten(conmesh))
alignvert = AlignVertices(Mesh=mjoin, Tolerance=0.1)  # -> Result, Count
weld = WeldMesh(Mesh=alignvert.Result, Angle=3.141592654)
subdmesh = SubDFromMesh(Mesh=weld, Creases=1, Corners=1, Interpolate=False)
subd = SubD(subdmesh)
mirror = Mirror(Geometry=subd, Plane=PlaneYZ(0, 0, 0))  # -> Geometry, Transform
context_bake = ContextBake(Geometry=[subd, mirror.Geometry])
context_bake_2 = ContextBake(Attractor=platoocta)
